# Grasshopper definition auto_entourage_dev.gh (Grasshopper 1.0.7)

code = FilePath("C:\Users\Vincent Mai\Desktop\Projects\speranza_architecture\auto_entourage\src\load_img.py")
file = ReadFile(File=code, PerLineParse=False)
path = FilePath("C:\Users\Vincent Mai\Desktop\Projects\speranza_architecture\auto_entourage\examples\entourages\trimmed\")
crv = Curve(<curve referenced from the Rhino model>)
python = GhPythonScript(Code=file, Path=path, Region=crv, Num=Slider(100, range=0..100), Run=Button())  # -> Out, A
panel = Panel(python.Out)
